# Grasshopper definition lightning.gh (Grasshopper 0.9.76)
# plug-ins: Python Interpreter

number_slider = Slider(-46, range=-180..180)
python_script = PythonScript(
    steps=Slider(38, range=1..50),
    stride=Slider(7.86, range=0..10),
    degrees=Slider(25, range=0..180),
    seed=Slider(19550, range=0..100000),
    split=Slider(0.0123, range=0..0.12))  # -> out, points, curve_list
# ---------- python_script: Python ----------
### Curvature turtle.
### Port of LORENZ LACHAUER script..
### http://eat-a-bug.blogspot.nl/2009/05/surface-turtle.html

# inputs: forward, left, srf, startpnt, startdir

import math
import random

import rhinoscriptsyntax as rs
import Rhino.Geometry as rg


def scale_vector(v, scale):
	return [scale * e for e in v] 


def get_intervals(n):
	if n == 0:
		return []
	elif n == 1:
		return [.5]
	else:
		return [e / float(n - 1) for e in range(n)]
	

def curve_at_param(c, p):
	"""
	converts from curve params to [0,1] domain.
	"""
	cmin, cmax = rs.CurveDomain(c)
	crange = cmax - cmin
	normalized_p = p * crange
	return cmin + normalized_p
	
	
def sample_interval(samples):
	r = range(samples)
	l = [1 / float(samples - 1) for e in range(samples)]
	return l
	
def construct_vectors(degrees, paths, scale):
	"""
	Function does too much.
	Constructs vectors based on 
	"""
	radians = degrees * (2 * math.pi / 360)
	intervals = get_intervals(paths)
	directions = [radians * e + direction - radians / 2 for e in intervals]
	vectors = [(math.sin(d), math.cos(d), 0) for d in directions]
	scaled = [scale_vector(v, scale) for v in vectors]
	return scaled
	
	
def construct_curve(p0, v, srf):
	p_free = rs.PointAdd(p0, v)
	u, v = rs.SurfaceClosestPoint(srf, p_free)
	xyz = rs.EvaluateSurface(srf, u, v)
	try: 
	    return rs.AddInterpCrvOnSrf(srf, [p0, xyz])
	except:
	    return None


def maximum_curvature(c, samples):
	samples = sample_interval(samples)
	cpx = [curve_at_param(c, s) for s in samples]
	curvature_radii = [rs.CurveCurvature(c, p)[3] for p in cpx]
	return max(curvature_radii)



#normal = rs.SurfaceNormal(srf, [7,7])

steps = int(steps)
paths = 10
direction = direction * 2 * math.pi / 360

if seed is not None:
	random.seed(seed)
	
u, v = rs.SurfaceClosestPoint(srf, start)
surface_xyz = rs.EvaluateSurface(srf, u, v)
surface_normal = rs.SurfaceNormal(srf, (u,v))

start = rg.Point3d([0,0,0])
points = [start]
curve_list = []

"""
surface_domain = [rs.SurfaceDomain(srf, e) for e in (0, 1)] # U, V
print(surface_domain)

for e in range(steps):
	vectors = construct_vectors(degrees, paths, stride)
	curves = [construct_curve(points[-1], v, srf) for v in vectors]
	curves = [e for e in curves if e]
	curvatures = [maximum_curvature(c, 3) for c in curves]
	if not curvatures:
		break
	index = curvatures.index(min(curvatures))
	curve_list.extend(curves)
	#print(maximum_curvature(curves[0], 10))
	
	#v = random.choice(vectors)
	v = vectors[index]
	
	px = rs.PointAdd(points[-1], v)
	u, v = rs.SurfaceClosestPoint(srf, px)
	xyz = rs.EvaluateSurface(srf, u, v)
	points.append(xyz)
	
	if u in surface_domain[0] or v in surface_domain[1]:
		break
	"""
# ---------- end python_script ----------
point = Point(python_script.points)
interpolate = Interpolate(Vertices=point, Degree=3, Periodic=False, KnotStyle=1)  # -> Curve, Length, Domain
