# Grasshopper definition stairs.gh (Grasshopper 0.9.76)

curve = Curve(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)
rise = Slider(7, range=0..10)
stair_height = Panel("144")
tread_width = Slider(36, range=0..100)
run = Slider(11, range=0..100)
unit_z = UnitZ(Factor=Slider(36, range=0..100))
unit_z_2 = UnitZ(Factor=stair_height)
end_points = EndPoints(Curve=curve)  # -> Start, End
extrude = Extrude(Base=curve, Direction=unit_z_2)
divide_distance = DivideDistance(Curve=curve, Distance=run)  # -> Points, Tangents, Parameters
list_length = ListLength(List=divide_distance.Points)
division = Division(A=stair_height, B=list_length)
multiplication = Multiplication(A=rise, B=list_length)
move = Move(Geometry=end_points.End, Motion=unit_z_2)  # -> Geometry, Transform
integer = Integer(division)
unit_z_3 = UnitZ(Factor=integer)
line = Line(StartPoint=end_points.Start, EndPoint=move.Geometry)
rotate = Rotate(Geometry=divide_distance.Tangents, Angle=degrees("-90"), Plane=PlaneXY(0, 0, 0))  # -> Geometry, Transform
plane_surface = PlaneSurface(Plane=PlaneXY(0, 0, 0), XSize=Domain(-10, 10), YSize=Domain(-10, 10))
move_2 = Move(Geometry=divide_distance.Points, Motion=rotate.Geometry)  # -> Geometry, Transform
move_3 = Move(Motion=unit_z)  # -> Geometry, Transform
scale = Scale(Geometry=move_2.Geometry, Center=divide_distance.Points, Factor=tread_width)  # -> Geometry, Transform
line_2 = Line(StartPoint=divide_distance.Points, EndPoint=scale.Geometry)
list_length_2 = ListLength(List=line_2)
series = Series(Start=0, Step=1, Count=list_length_2)
shift_list = ShiftList(List=line_2, Shift=1, Wrap=False)
multiplication_2 = Multiplication(A=series, B=unit_z_3)
shortest_list = ShortestList(ListA=shift_list, ListB=multiplication_2, TrimMode=2)  # -> ListA, ListB
move_4 = Move(Geometry=line_2, Motion=multiplication_2)  # -> Geometry, Transform
move_5 = Move(Geometry=shift_list, Motion=shortest_list.ListB)  # -> Geometry, Transform
shortest_list_2 = ShortestList(ListA=move_5.Geometry, ListB=move_4.Geometry, TrimMode=2)  # -> flatten(ListA), flatten(ListB)
entwine = Entwine(Branch00=shortest_list_2.ListA, Branch01=shortest_list_2.ListB, FlattenInputs=True)
flip_matrix = FlipMatrix(Data=entwine)
loft = Loft(Curves=flip_matrix, Options={Adjust=False, Closed=False, LoftEnds=0, LoftSimp=0, LoftType=0, Rebuild=10, Refit=0.01})
unit_z_4 = UnitZ(Factor=Slider(3, range=0..10))
extrude_2 = Extrude(Base=loft, Direction=unit_z_4)
