# Grasshopper definition tree.gh (Grasshopper 0.9.76)

xy_plane = XYPlane(Origin=Point(0, 0, 0))
number_slider = Slider(6, range=0..10)
point = Point(Point(0, 0, 0))
number_slider_2 = Slider(40813, range=0..100000)
number_slider_3 = Slider(5, range=0..10)
number_slider_4 = Slider(10, range=0..10)
construct_domain = ConstructDomain(DomainStart=Slider(0, range=0..100), DomainEnd=Slider(360, range=0..1000))
random = Random(Range=construct_domain, Number=number_slider, Seed=number_slider_2)
construct_domain_2 = ConstructDomain(DomainStart=Slider(5, range=-30..30), DomainEnd=Slider(30, range=-30..30))
construct_domain_3 = ConstructDomain(DomainStart=Slider(-19, range=-30..30), DomainEnd=Slider(0, range=-30..30))
unit_y = UnitY(Factor=number_slider_3)
unit_y_2 = UnitY(Factor=number_slider_4)
move = Move(Geometry=point, Motion=unit_y)  # -> Geometry, Transform
random_2 = Random(Range=construct_domain_3, Number=number_slider, Seed=number_slider_2)
move_2 = Move(Geometry=point, Motion=unit_y_2)  # -> Geometry, Transform
random_3 = Random(Range=construct_domain_2, Number=number_slider, Seed=number_slider_2)
rotate = Rotate(Geometry=move.Geometry, Angle=degrees(random), Plane=xy_plane)  # -> Geometry, Transform
circle = Circle(Plane=xy_plane, Radius=number_slider_3)
circle_2 = Circle(Plane=xy_plane, Radius=number_slider_4)
addition = Addition(A=random_2, B=random)
rotate_2 = Rotate(Geometry=move_2.Geometry, Angle=degrees(addition), Plane=xy_plane)  # -> Geometry, Transform
addition_2 = Addition(A=random_3, B=random)
rotate_3 = Rotate(Geometry=move_2.Geometry, Angle=degrees(addition_2), Plane=xy_plane)  # -> Geometry, Transform
line = Line(StartPoint=rotate.Geometry, EndPoint=rotate_2.Geometry)
line_2 = Line(StartPoint=rotate.Geometry, EndPoint=rotate_3.Geometry)
panel = Panel(line)
join_curves = JoinCurves(Curves=[line, line_2], Preserve=False)
shatter = Shatter()
